# Grasshopper definition ACORN-shell.gh (Grasshopper 1.0.7)
# plug-ins: HAL for Grasshopper, AcornShell, karambaGH

sessionsettings = SessionSettings()
rectangle = Rectangle(Plane=PlaneXY(0, 0, 0), XSize="-3 to 3", YSize="-3 to 3", Radius=0)  # -> Rectangle, Length
rectangle_2 = Rectangle(Plane=PlaneXY(0, 0, 0), XSize="-3.9 to 3.9", YSize="-3.6 to 3.6", Radius=0)  # -> Rectangle, Length
acorn_makeplan = MakePlan(Outline=rectangle_2.Rectangle, Corner_radius=Slider(0.2, range=0..1))  # -> Plan, Corners, Edges
python = GhPythonScript()  # -> a
# ---------- python: Python ----------
from ghpythonlib.componentbase import executingcomponent as component
import Grasshopper, GhPython
import System
import Rhino
import rhinoscriptsyntax as rs

class MyComponent(component):
    
    def RunScript(self, x, y):
        """Provides a scripting component.
            Inputs:
                x: The x script variable
                y: The y script variable
            Output:
                a: The a output variable"""
        
        __author__ = "Mishael Nuh"
        __version__ = "2021.01.20"
        
        import rhinoscriptsyntax as rs
        
        # return outputs if you have them; here I try it for you:
        return a
# ---------- end python ----------
brep = Brep(acorn_makeplan.Plan)
acorn_formfind = FormFind(Plan_surface=brep, Corners=acorn_makeplan.Corners, Height=Slider(0.8, range=0..1), Run=Button())  # -> Form_found_surface, Kiwi_errors
srf = Surface(acorn_formfind.Form_found_surface)
mesh_breps = MeshBrepsKaramba3D(
    Brep=srf,
    MeshResolution=Slider(0.095, range=0..1),
    EdgeRefinementFactor=0.67,
    PointReduction=Toggle(False),
    SmoothingStepSize=Slider(1, range=0..1),
    SmoothingIterations=Slider(1, range=0..10))  # -> Mesh, Info
acorn_buildshellmodel = BuildShellModel(Mesh=mesh_breps.Mesh, Corners=acorn_makeplan.Corners, Thickness=Slider(0.06, range=0..0.1))
analyze = AnalyzeKaramba3D(Model=acorn_buildshellmodel)  # -> CalculatedModel, MaximumDisplacement_cm, ResultingForceOfGravity_kN, ElasticEnergy_kNm
acorn_stresslines = StressLines(
    K3d_model=analyze.CalculatedModel,
    Surface=srf,
    Corners=acorn_makeplan.Corners,
    Edges=acorn_makeplan.Edges,
    Keystone_width=Slider(1.6, range=0..10),
    Cornerstone_width=Slider(1.5, range=0..10),
    Length_param_1=Slider(2, range=0..10),
    Length_param_2=Slider(2, range=0..10))  # -> Stress_lines_1, Stress_lines_2, Cable_profiles_1, Cable_profiles_2
crv = Curve(acorn_stresslines.Cable_profiles_2)
acorn_segment = Segment(Surface=srf, Stress_lines_1=acorn_stresslines.Stress_lines_1, Stress_lines_2=acorn_stresslines.Stress_lines_2)
brep_2 = Brep(acorn_segment)
