# Grasshopper definition visualiseDemoBuilding.gh (Grasshopper 1.0.7)

_6x6 = Surface(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)
lor_7_8x7_2 = Surface(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)
_6x6_segments = Surface([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])
lor_segments = Surface([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])
segments_proj = Surface(lor_segments)
shell = Surface(lor_7_8x7_2)

# ---- group: {manual} segmentation
shell_2 = Surface(shell)
project = Project(Curve=segments_proj, Brep=shell_2, Direction=Vector(0, 0, 1))  # -> simplify(Curve)
srfsplit = SurfaceSplit(Surface=shell_2, Curves=project)  # -> simplify(Fragments)
area = Area(Geometry=srfsplit)  # -> Area, Centroid
sort = SortList(Keys=area.Area, ValuesA=srfsplit)  # -> Keys, ValuesA
item = ListItem(List=sort.ValuesA, Index=0, Wrap=True)

# ----
segments = Surface(item)
shell_3 = Surface(shell)
column_height = Slider(3, range=0..10)
bbox = BoundingBox(Content=shell_3, Plane=PlaneXY(0, 0, 0), UnionBox=True)  # -> Box, Box_2
box_corners = BoxCorners(Box=bbox.Box)  # -> CornerA, CornerB, CornerC, CornerD, CornerE, CornerF, CornerG, CornerH
merge = Merge(Data1=box_corners.CornerA, Data2=box_corners.CornerB, Data3=box_corners.CornerC, Data4=box_corners.CornerD)
subtraction = Subtraction(A=column_height, B=Slider(0.4, range=0..1))
number_slider = Slider(0.15, range=0..0.2)
subtraction_2 = Subtraction(A=subtraction, B=number_slider)
Z = UnitZ(Factor=subtraction_2)
Z_2 = UnitZ(Factor=number_slider)
pt = Point(merge)
move = Move(Geometry=pt, Motion=Z)  # -> Geometry, Transform
move_2 = Move(Geometry=pt, Motion=Z_2)  # -> Geometry, Transform
Z_3 = UnitZ(Factor=Slider(0.05, range=0..0.1))
pt_2 = Point(merge)
merge_2 = Merge(Data1=move_2.Geometry, Data2=move.Geometry)
cyl = Cylinder(Base=pt_2, Radius=Slider(0.1, range=0..1), Length=column_height)
bbox_2 = BoundingBox(Content=merge_2, Plane=PlaneXY(0, 0, 0), UnionBox=True)  # -> Box, Box_2
extr = Extrude(Base=segments, Direction=Z_3)
cap = CapHoles(Brep=cyl)
pline = PolyLine(Vertices=move.Geometry, Closed=True)
box_corners_2 = BoxCorners(Box=bbox_2.Box)  # -> CornerA, CornerB, CornerC, CornerD, CornerE, CornerF, CornerG, CornerH
box_corners_3 = BoxCorners(Box=bbox_2.Box)  # -> CornerA, CornerB, CornerC, CornerD, CornerE, CornerF, CornerG, CornerH
Z_4 = UnitZ(Factor=subtraction)
explode = Explode(Curve=pline, Recursive=True)  # -> Segments, Vertices
ln = Line(StartPoint=box_corners_2.CornerF, EndPoint=box_corners_2.CornerH)
ln_2 = Line(StartPoint=box_corners_2.CornerE, EndPoint=box_corners_2.CornerG)
ln_3 = Line(StartPoint=box_corners_3.CornerC, EndPoint=box_corners_3.CornerF)
ln_4 = Line(StartPoint=box_corners_3.CornerB, EndPoint=box_corners_3.CornerG)
ln_5 = Line(StartPoint=box_corners_3.CornerC, EndPoint=box_corners_3.CornerH)
ln_6 = Line(StartPoint=box_corners_3.CornerD, EndPoint=box_corners_3.CornerG)
move_3 = Move(Geometry=extr, Motion=Z_4)  # -> Geometry, Transform
move_4 = Move(Geometry=pt, Motion=Z_4)  # -> Geometry, Transform
merge_3 = Merge(Data1=ln_2, Data2=ln)
merge_4 = Merge(Data1=ln_3, Data2=ln_4, Data3=ln_5, Data4=ln_6)
neg = Negative(Value=Slider(0.44, range=0..1))
cyl_2 = Cylinder(Base=move_4.Geometry, Radius=Slider(0.2, range=0..1), Length=Slider(0.08, range=0..0.1))
number_slider_2 = Slider(0.02, range=0..0.1)
cone = Cone(Base=move_4.Geometry, Radius=Slider(0.23, range=0..1), Length=neg)  # -> Cone, Tip
merge_5 = Merge(Data1=merge_4, Data2=merge_3, Data3=explode.Segments)  # -> flatten(Result)
cap_2 = CapHoles(Brep=cyl_2)
cap_3 = CapHoles(Brep=cone.Cone)
merge_6 = Merge(Data2=cap_3, Data3=cap)
brep = Brep(move_3.Geometry)
edges = BrepEdges(Brep=brep)  # -> Naked, Interior, NonManifold
pipe = Pipe(Curve=merge_5, Radius=number_slider_2, Caps=0)
sunion = SolidUnion(Breps=merge_6)  # -> graft(Result)
crv = Curve(merge_5)
lng = ListLength(List=edges.Interior)
multiplication = Multiplication(A=number_slider_2, B=Slider(1.3, range=1..2))
bcx = BrepCurve(Brep=sunion, Curve=crv)  # -> Curves, Points
series = Series(Start=0, Step=1, Count=lng)  # -> simplify(Series)
sph = Sphere(Base=bcx.Points, Radius=multiplication)
filedge = FilletEdge(Shape=brep, Blend=0, Metric=0, Edges=series, Radii=Slider(0.02, range=0..0.03))
merge_7 = Merge(Data2=pipe, Data3=sph)
merge_8 = Merge(Data1=filedge, Data2=cap_3, Data3=cap, Data4=cap_2)
preview = CustomPreview(Geometry=merge_7, Material=ColourSwatch(SwatchColor=RGB(117, 117, 117)))  # disabled
preview_2 = CustomPreview(Geometry=merge_8, Material=ColourSwatch(SwatchColor=RGB(207, 207, 207)))  # disabled
