# Grasshopper definition WIP_example_segmentedShellAnalysis.gh (Grasshopper 1.0.7)
# plug-ins: ACORNshells, karambaGH

# ----
# test surfaces
number_slider = Slider(6, range=0..10)
rectangle = Rectangle(Plane=PlaneXY(0, 0, 0), XSize=number_slider, YSize=number_slider, Radius=0)  # -> Rectangle, Length
pop2d = Populate2D(Region=rectangle.Rectangle, Count=100, Seed=1)
del = DelaunayMesh(Points=pop2d, Plane=PlaneXY(0, 0, 0))
demesh = DeconstructMesh(Mesh=del)  # -> Vertices, Faces, Colours, Normals
conmesh = ConstructMesh(Vertices=demesh.Vertices, Faces=graft(demesh.Faces))  # -> simplify(Mesh)
medges = MeshEdges(Mesh=conmesh)  # -> NakedEdges, InteriorEdges, NonManifoldEdges
boundary = BoundarySurfaces(Edges=medges.NakedEdges)  # -> simplify(flatten(Surfaces))
test_surface = TestSurface()
segments = Surface(boundary)

spring_spacing = Number(Slider(0.5, range=0..1))
segments_2 = Surface([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])
gap_size = Number(Slider(0.1, range=0..0.1))
a_springs = MakeSprings(ShellSegments=test_surface, SpringDistance=spring_spacing, GapSize=gap_size)  # -> OffsetSegments, SegmentSpringLocations, EdgeSpringLocations, SpringLines, GapSize, GapSize_2

panel = Panel("main direction")
_10º = PowerOf10(Value=Slider(3, range=-6..10))
multiplication = Multiplication(A=Slider(1, range=1..10), B=_10º)

_10º_2 = PowerOf10(Value=Slider(5, range=0..10))
_10º_3 = PowerOf10(Value=Slider(7, range=0..10))
_10º_4 = PowerOf10(Value=Slider(5, range=0..10))
_10º_5 = PowerOf10(Value=Slider(2, range=0..10))
_10º_6 = PowerOf10(Value=Slider(5, range=0..10))
_10º_7 = PowerOf10(Value=Slider(1, range=0..10))
_10º_8 = PowerOf10(Value=Slider(5, range=0..10))
multiplication_2 = Multiplication(A=Slider(1, range=0..1), B=_10º_4)
multiplication_3 = Multiplication(A=Slider(1, range=0..1), B=_10º_2)
multiplication_4 = Multiplication(A=Slider(1, range=0..1), B=_10º_6)
multiplication_5 = Multiplication(A=Slider(1, range=0..1), B=_10º_7)
multiplication_6 = Multiplication(A=Slider(1, range=0..1), B=_10º_5)
multiplication_7 = Multiplication(A=Slider(1, range=1..10), B=_10º_3)
multiplication_8 = Multiplication(A=Slider(1, range=0..1), B=_10º_8)
vec = VectorXYZ(XComponent=multiplication_2, YComponent=multiplication_4, ZComponent=multiplication_3)  # -> Vector, Length
# spring setup
vec_2 = VectorXYZ(XComponent=multiplication_7, YComponent=multiplication_7, ZComponent=multiplication_7)  # -> Vector, Length
vec_3 = VectorXYZ(XComponent=multiplication_5, YComponent=multiplication, ZComponent=multiplication_6)  # -> Vector, Length
vec_4 = VectorXYZ(XComponent=multiplication_8, YComponent=multiplication_8, ZComponent=multiplication_8)  # -> Vector, Length
cross_section = CrossSectionKaramba3D(
    FamilyNameOfCrossSection="DefaultCroSec",
    ElementIdentifier="spring",
    CTranslation_kN_m=vec_2.Vector,
    CRotation_kNm_rad=vec_3.Vector,
    mode="Spring")
segments_3 = Surface([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])
spring_spacing_2 = Number(Slider(0.1, range=0..1))
thickness_m = Number(Slider(0.06, range=0..0.1))
gap_size_2 = Number(Slider(0.02, range=0..0.1))
shell = Geometry(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)
crosec = CrossSectionKaramba(cross_section)
a_springs_2 = MakeSprings(ShellSegments=segments_3, SpringDistance=spring_spacing_2, GapSize=gap_size_2, SpringsCrossSection=crosec)  # -> OffsetSegments, SegmentSpringLocations, EdgeSpringLocations, SpringLines, KarambaSprings, GapSize
Z = UnitZ(Factor="5")
move = Move(Geometry=shell, Motion=Z)  # -> Geometry, Transform
segmentspringlocations = Geometry(a_springs_2.SegmentSpringLocations)
offsetsegments = Geometry(a_springs_2.OffsetSegments)
edgespringlocations = Geometry(a_springs_2.EdgeSpringLocations)
springlines = Geometry(a_springs_2.SpringLines)
gapsize = Number(a_springs_2.GapSize)
number_slider_2 = Slider(1, range=0..1)
number_slider_3 = Slider(0.1, range=0..1)
mesh_breps = MeshBrepsKaramba3D(
    Brep=offsetsegments,
    InclusionPoints=segmentspringlocations,
    MeshResolution=number_slider_3,
    EdgeRefinementFactor=number_slider_2,
    PointReduction=False,
    SmoothingStepSize=Slider(1, range=0..1),
    SmoothingIterations=Slider(3, range=0..10))  # -> Mesh, Info
segments_mesh = Mesh(mesh_breps.Mesh)
load_pattern = Slider(1, range=1..7)
image = ImageSampler(Filter="Colour", Interpolate=False, Umax=1, Umin=0, Vmax=1, Vmin=0, Wrap=1)
matselect = MaterialSelectionKaramba3D(menu=[dropdown(3), dropdown(9)])
dead_load_kn_m2 = Slider(1, range=0..10)
live_load_kn_m2 = Slider(5, range=0..10)
toggle = BooleanToggle(True)
mesh = Mesh(segments_mesh)
load_pattern_2 = Integer(load_pattern)

shell_2 = Surface(move.Geometry)
mesh_breps_2 = MeshBrepsKaramba3D(
    Brep=shell_2,
    MeshResolution=number_slider_3,
    EdgeRefinementFactor=number_slider_2,
    PointReduction=False,
    SmoothingStepSize=Slider(1, range=0..1),
    SmoothingIterations=Slider(3, range=0..10))  # -> Mesh, Info
mesh_2 = Mesh(mesh_breps_2.Mesh)
thickness_m_2 = Number(thickness_m)
a_shellloads = ShellLoads(Mesh=mesh_2, DeadLoadValue=dead_load_kn_m2, LiveLoadValue=live_load_kn_m2, LiveLoadPattern=load_pattern_2)  # -> Loads, CheckPoints
a_makeshell = MakeKarambaShellElement(ShellSurface=shell_2, Meshes=mesh_2, Thickness=thickness_m_2, Material=matselect, FixedSupport=toggle)  # -> ShellElements, ShellSupports
assemble = AssembleModelKaramba3D(Elem=a_makeshell.ShellElements, Support=a_makeshell.ShellSupports, Load=a_shellloads.Loads, LimitDistance_m=0.005)  # -> Model, Info, Mass_kg, CenterOfGravity
analyze = AnalyzeKaramba3D(Model=assemble.Model)  # -> CalculatedModel, MaximumDisplacement_cm, ResultingForceOfGravity_kN, ElasticEnergy_kNm
modelview = ModelViewKaramba3D(Model=analyze.CalculatedModel, ResultFactors=1, ResultCase=-1)  # -> Model, DeformedMesh, DeformedAxes, DeformedModel

segments_mesh_2 = Mesh(flatten(segments_mesh))
a_makeshell_2 = MakeKarambaShellElement(ShellSurface=shell, Meshes=flatten(mesh), Thickness=thickness_m, Material=matselect, FixedSupport=toggle)  # -> ShellElements, ShellSupports
springs = ElementKaramba3D(a_springs_2.KarambaSprings)
a_shellloads_2 = ShellLoads(Mesh=segments_mesh_2, DeadLoadValue=dead_load_kn_m2, LiveLoadValue=live_load_kn_m2, LiveLoadPattern=load_pattern_2)  # -> Loads, CheckPoints
merge = Merge(Data1=flatten(springs), Data2=flatten(a_makeshell_2.ShellElements))
element = ElementKaramba(merge)

# ----
# Karamba analysis
# and results
assemble_2 = AssembleModelKaramba3D(Elem=element, Support=a_makeshell_2.ShellSupports, Load=a_shellloads_2.Loads, LimitDistance_m=0.005)  # -> Model, Info, Mass_kg, CenterOfGravity
analyze_2 = AnalyzeKaramba3D(Model=assemble_2.Model)  # -> CalculatedModel, MaximumDisplacement_cm, ResultingForceOfGravity_kN, ElasticEnergy_kNm
modelview_2 = ModelViewKaramba3D(Model=analyze_2.CalculatedModel, ResultFactors=1, ResultCase=-1)  # -> Model, DeformedMesh, DeformedAxes, DeformedModel
medges_2 = MeshEdges(Mesh=modelview_2.DeformedMesh)  # -> NakedEdges, InteriorEdges, NonManifoldEdges

analyzethii = AnalyzeThIIKaramba3D(Model=assemble_2.Model, RTolerance=1e-07, MaxIterations=50, NoTensionalNII=False)  # -> CalculatedModel, MaximumDisplacement_cm, ResultingForceOfGravity_kN, ElasticEnergy_kNm; disabled
bmodes = BucklingModesKaramba3D(
    Model=analyzethii.CalculatedModel,
    FromIndex=1,
    NumberOfModes=Slider(3, range=0..10),
    MaximumNumberOfIterations=300,
    Epsilon=1e-07)  # -> ModelWithBucklingModesAsLoadCaseResults, BucklingLoadFactors
disassemble = DisassembleModelKaramba3D(Model=analyze_2.CalculatedModel)  # -> Model, Point, Beam, Shell, Support, Load, Line, Mesh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
panel_2 = Panel(bmodes.BucklingLoadFactors)
disassemble_2 = DisassembleElementKaramba3D(Element=disassemble.Shell)  # -> Element, ElementIdentifier, AxisOfElement, CrossSection, Joints, Material, LocalCoordinateSystem, ElementIsActive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
panel_3 = Panel(disassemble_2.CrossSection)
crv = Curve(modelview_2.DeformedAxes)
explode = Explode(Curve=simplify(crv), Recursive=True)  # -> Segments, Vertices
shellview = ShellViewKaramba3D(Model=[modelview_2.Model, modelview.Model], IndexOfLayer=0)  # -> Model, MeshesOfRenderedShells, LegendColors, LegendTags
number_slider_4 = Slider(0.02, range=0..0.1)
item = ListItem(List=explode.Segments, Index=Slider(0, range=0..1), Wrap=True)
mesh_3 = Mesh(shellview.MeshesOfRenderedShells)
legend = Legend(Colour=shellview.LegendColors, Tags=shellview.LegendTags, LegendType=1)
end = EndPoints(Curve=item)  # -> Start, End
model = ModelKaramba3D(modelview_2.Model)
item_2 = ListItem(List=reverse(shellview.LegendTags), Index=0, Wrap=True)  # -> Item, Item1
item_3 = ListItem(List=shellview.LegendTags, Index=0, Wrap=True)  # -> Item, Item1
gapsize_2 = Number(gapsize)
panel_4 = Panel(item_3.Item1)
panel_5 = Panel(item_2.Item1)
multiplication_9 = Multiplication(A=gapsize_2, B="2")
scale = Scale(Geometry=item, Center=end.Start, Factor=multiplication_9)  # -> Geometry, Transform
model_2 = ModelKaramba3D(modelview_2.Model)
crv_2 = Curve(medges_2.NakedEdges)
mesh_4 = Mesh(modelview_2.DeformedMesh)
merge_viz = Merge(Data1=crv_2, Data2=model_2, Data3=mesh_4, Data4=scale.Geometry)
viz_springs = VizSprings(spring_line=scale.Geometry, scale=Slider(0.5, range=0..1))
max_stress_comp = Number(item_3.Item1)
max_stress_tens = Number(item_2.Item1)
max_disp = Number(analyze_2.MaximumDisplacement_cm)
mag_ct = Integer()
geo = Geometry(viz_springs)
rec = DataRecorder(max_stress_tens, DataLimit=-10, RecordData=False)
rec_2 = DataRecorder(max_stress_comp, DataLimit=-10, RecordData=False)
rec_3 = DataRecorder(mag_ct, DataLimit=-10, RecordData=False)
rec_4 = DataRecorder(max_disp, DataLimit=-10, RecordData=False)
quick_graphs = QuickGraphs()

cables = Curve()  # disabled
offsetsegments_2 = Geometry(offsetsegments)  # disabled
cables_2 = BooleanToggle(False)  # disabled

# ----
# if input cables disabled, split segments is same as input segments
cables_3 = Curve(cables)  # disabled

embed_cables = EmbedCables(segments=offsetsegments_2, cables=cables_3)  # -> split_segments_2, split_cables_2; disabled
split_cables = Geometry(embed_cables.split_cables_2)  # disabled
filter = StreamFilter(Gate=cables_2, Stream0=offsetsegments_2, Stream1=embed_cables.split_segments_2)  # disabled

# ---- group: PT in mesh for Karamba
number_slider_5 = Slider(0.01, range=0..0.1)  # disabled
curveclosestmeshvert = CurveClosestMeshVert(segments=segments_mesh, cables=split_cables, tol=number_slider_5)  # -> simplify(polyline_2); disabled
number_slider_6 = Slider(16.618, range=0..100)  # disabled
posttensioning = PostTensioning(pt_force=number_slider_6, cables=curveclosestmeshvert)  # -> simplify(pt_intersection_nodes_3), vec_pt_force_4, vec_end_force_2; disabled

# ==== cluster CurveClosestMeshVert
number_slider = Slider(8, range=0..100)
segments = ClusterInput()
cables = ClusterInput()
tol = ClusterInput()
tol_2 = Number(tol)
segments_2 = Mesh(segments)
number_slider_2 = Slider(0.01, range=0..0.01)
cables_2 = Curve(cables)
branch = TreeBranch(Tree=segments_2, Path=number_slider, MaintainPaths=True)
branch_2 = TreeBranch(Tree=cables_2, Path=number_slider, MaintainPaths=True)
mesh = Mesh(segments_2)
curve = Curve(cables_2)

# ---- group: exclude segments without cables
tstat = TreeStatistics(Tree=cables_2)  # -> Paths, Length, Count
branch_3 = TreeBranch(Tree=mesh, Path=tstat.Paths, MaintainPaths=True)

# ----
deconstruct_mesh = DeconstructMesh(Mesh=branch_3)  # -> simplify(Vertices), Faces, Colours, Normals

# ---- group: "manual" cross reference
group = Group(Objects=deconstruct_mesh.Vertices)
lng = ListLength(List=curve)
repeat = RepeatData(Data=group, Length=lng)  # -> simplify(Data)
ungroup = Ungroup(Group=repeat)

# ----
curve_2 = Curve(graft(curve))
pull = PullPoint(Point=ungroup, Geometry=curve_2, ClosestOnly=True)  # -> ClosestPoint, Distance
smaller = SmallerThan(FirstNumber=pull.Distance, SecondNumber=tol_2)  # -> SmallerThan, OrEqualTo
dispatch = Dispatch(List=pull.ClosestPoint, DispatchPattern=smaller.SmallerThan)  # -> ListA, ListB
pt = Point(dispatch.ListA)
sort_along_curve = SortAlongCurve(Points=pt, Curve=curve_2)  # -> simplify(Points), Indices
cullpt = CullDuplicates(Points=sort_along_curve.Points, Tolerance=tol_2, CullMode=3)  # -> Points, Indices, Valence
polyline = PolyLine(Vertices=cullpt.Points, Closed=False)
polyline_2 = ClusterOutput(polyline)

# ==== cluster PostTensioning
cables = ClusterInput()
pt_force = ClusterInput()
cables_2 = Geometry(cables)
pt_force_2 = Number(pt_force)

# ----
# PT forces
pt_kn = Number(pt_force_2)
crv = Curve(cables_2)
flip = FlipCurve(Curve=crv)  # -> Curve, Flag
explode = Explode(Curve=crv, Recursive=True)  # -> Segments, simplify(Vertices)
crv_2 = Curve(crv)
lng = ListLength(List=explode.Vertices)
series = Series(Start=0, Step=1, Count=lng)  # -> simplify(Series)
int = Integer(series)
neg = Negative(Value=int)
eval = EvaluateCurve(Curve=graft(crv_2), Parameter=int)  # -> Point, Tangent, Angle
eval_2 = EvaluateCurve(Curve=graft(flip.Curve), Parameter=neg)  # -> Point, Tangent, Angle
pt_intersection_nodes = Point(eval.Point)

intcrv = Interpolate(Vertices=explode.Vertices, Degree=3, Periodic=False, KnotStyle=1)  # -> Curve, Length, Domain
nurbs = NurbsCurve(Vertices=explode.Vertices, Degree=3, Periodic=False)  # -> Curve, Length, Domain
crvgraph = CurvatureGraph(Curve=intcrv.Curve, Density=5, Scale=Slider(103, range=0..120))
crossref = CrossReference(ListA=graft(pt_kn), ListB=eval.Point, CrossMode=1)  # -> ListA, ListB

amp = Amplitude(Vector=eval_2.Tangent, Amplitude=simplify(crossref.ListA))
amp_2 = Amplitude(Vector=eval.Tangent, Amplitude=simplify(crossref.ListA))
addition = Addition(A=amp_2, B=amp)
vdis = VectorDisplay(Anchor=pt_intersection_nodes, Vector=amp)
vdis_2 = VectorDisplay(Anchor=pt_intersection_nodes, Vector=amp_2)
vec_pt_force = Vector(addition)
vdis_3 = VectorDisplay(Anchor=pt_intersection_nodes, Vector=vec_pt_force)

item = ListItem(List=reverse(amp_2), Index=0, Wrap=True)
item_2 = ListItem(List=reverse(eval.Point), Index=0, Wrap=True)
item_3 = ListItem(List=eval_2.Point, Index=0, Wrap=True)
item_4 = ListItem(List=amp, Index=0, Wrap=True)
vdis_endforce = VectorDisplay(Anchor=item_2, Vector=item)
vdis_endforce_2 = VectorDisplay(Anchor=item_3, Vector=item_4)
merge = Merge(Data1=item, Data2=item_4)
pt_intersection_nodes_2 = Point(pt_intersection_nodes)
vec_end_force = Vector(merge)
vec_pt_force_2 = Vector(addition)
vec_end_force_2 = ClusterOutput(vec_end_force)
move = Move(Geometry=pt_intersection_nodes_2, Motion=vec_pt_force_2)  # -> Geometry, Transform

# ---- group: pair up curve intersection points by index, returns uniques
vec_pt_force_3 = Vector(flatten(vec_pt_force))
pt = Point(flatten(pt_intersection_nodes))
rdpoints = RemoveDuplicatePointsKaramba3D(Point=pt, LimitDistance=0.005)  # -> OutPoint, Info, Indexes
item_5 = ListItem(List=pt, Index=rdpoints.Indexes, Wrap=True)
cp = ClosestPoint(Point=item_5, Cloud=pt)  # -> ClosestPoint, simplify(graft(CPIndex)), Distance
merge_2 = Merge(Data1=simplify(graft(rdpoints.Indexes)), Data2=cp.CPIndex)
item_6 = ListItem(List=vec_pt_force_3, Index=merge_2, Wrap=True)
item_7 = ListItem(List=pt, Index=merge_2, Wrap=True)
ma = MassAddition(Input=item_6)  # -> Result, PartialResults
item_8 = ListItem(List=item_7, Index=0, Wrap=True)
vdisex = VectorDisplayEx(Point=item_8, Vector=ma.Result, Colour=RGB(0, 0, 0), Width=Slider(3, range=0..10))

# ----
pline = PolyLine(Vertices=move.Geometry, Closed=False)  # disabled
curve = Curve(pline)  # disabled
pt_intersection_nodes_3 = ClusterOutput(pt_intersection_nodes_2)
vec_pt_force_4 = ClusterOutput(vec_pt_force_2)

# ==== cluster EmbedCables
segments = ClusterInput()
cables = ClusterInput()
segments_2 = Surface(simplify(segments))
cables_2 = Curve(cables)
surface_curve = SurfaceCurve(Surface=segments_2, Curve=flatten(cables_2))  # -> simplify(Curves), Points, UVPoints, Normals, Parameters, Tangents
trim = TrimTree(Tree=surface_curve.Curves, Depth=1)
srfsplit = SurfaceSplit(Surface=segments_2, Curves=trim)
trim_2 = TrimTree(Tree=srfsplit, Depth=1)
split_segments = Geometry(trim_2)
split_cables = Geometry(trim)
split_segments_2 = ClusterOutput(split_segments)
split_cables_2 = ClusterOutput(split_cables)

# ==== cluster TestSurface
number_slider = Slider(3, range=0..10)
srf = Surface(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)
scale_nu = ScaleNU(Geometry=srf, Plane=PlaneXY(0, 0, 0), ScaleX=1, ScaleY=1, ScaleZ=Slider(1.042, range=0..5))  # -> Geometry, Transform
panel = Panel("1")
srf_2 = Surface(scale_nu.Geometry)
divide = DivideDomain²(Domain=srf_2, UCount=number_slider, VCount=number_slider)
subsrf = Isotrim(Surface=reparameterize(srf_2), Domain=divide)
S = ClusterOutput(subsrf)

# ==== cluster QuickGraphs

# ---- group: whole shell
max_stress_comp = Number(-0.146)
max_stress_tens = Number(0.186)
max_disp = Number(0.03259199848)

# ----
max_stress_comp_2 = Number([-0.736, -0.51, -0.109, -0.151, -0.157, -0.148, -0.147, -0.147, -0.147, -0.147, -0.147])
max_stress_tens_2 = Number([4.69, 3.24, 0.333, 0.164, 0.224, 0.191, 0.184, 0.183, 0.183, 0.183, 0.183])
max_disp_2 = Number([1.58279036, 1.182691614, 0.3778172142, 0.1103610701, 0.05740937502, 0.03608507293, 0.032556884, 0.03216712047, 0.03212689201, 0.03212284776, 0.03212244312])
mag_ct = Integer([0, 1, 2, 3, 4, 5, 6, 7, 8, 9, 10])
merge = Merge(Data1=graft(max_stress_comp_2), Data2=graft(max_stress_tens_2), Data3=graft(max_disp_2))  # -> simplify(Result)
panel = Panel("""max stress comp
max stress tens
max disp""")
merge_2 = Merge(Data1=graft(max_stress_comp), Data2=graft(max_stress_tens), Data3=graft(max_disp))  # -> simplify(Result)
panel_2 = Panel(merge_2)
flip = FlipMatrix(Data=merge)
panel_3 = Panel(flip)
chart = CreateChart(
    ChartName="My Chart",
    ChartSeries=panel,
    ChartXAxisLabels=mag_ct,
    ValueTree=flip,
    Chart_Theme="Bright Pastel",
    Chart_Type="Line")

# ==== cluster VizSprings
spring_line = ClusterInput()
scale = ClusterInput()
spring_line_2 = Geometry(spring_line)
scale_2 = Number(scale)
len = Length(Curve=spring_line_2)
multiplication = Multiplication(A=len, B=scale_2)
division = Division(A=multiplication, B="2")
eval = EvaluateCurve(Curve=reparameterize(spring_line_2), Parameter=".5")  # -> Point, Tangent, Angle
number_slider = Slider(5, range=0..10)
pl = PlaneNormal(Origin=eval.Point, ZAxis=eval.Tangent)
sph = Sphere(Base=pl, Radius=division)
range = Range(Domain=number_slider, Steps=Slider(100, range=0..100))
division_2 = Division(A=range, B=number_slider)
pt = ConstructPoint(XCoordinate=range, YCoordinate=division_2, ZCoordinate=0)
crvsrf = CurveOnSurface(Surface=reparameterize(sph), UVCoordinates=pt, Closed=False)  # -> Curve, Length, Domain
C = ClusterOutput(crvsrf.Curve)
